# Grasshopper definition AI_Facade_Control_System_alg.gh (Grasshopper 1.0.8)
# plug-ins: LunchBox

trigger = Trigger(Interval=2000, TimerInterval=2000, Target=c_script)  # disabled
c_script = CSharpScript(reset=Button())  # -> out, A; inputs reset: Boolean
# ---------- c_script: C# ----------
    if(reset)i = 0; else i++;
    A = i;
# ---------- c_script: C# additional code ----------
  int i;
# ---------- end c_script ----------

opaquemod3 = HBOpaqueModifier3(name="walls", r_ref="0.5", g_ref="0.5", b_ref="0.5")  # -> modifier; plug-in component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
panel = Panel("https://energyplus-weather.s3.amazonaws.com/north_and_central_america_wmo_region_4/USA/MA/USA_MA_Boston-Logan.Intl.AP.725090_TMY3/USA_MA_Boston-Logan.Intl.AP.725090_TMY3.zip")
series = Series(Start="1", Step="1", Count="12")
series_2 = Series(Start="1", Step="1", Count="31")
series_3 = Series(Start="9", Step="1", Count="9")
downloadepw = LBDownloadWeather(weather_URL=panel)  # -> epw_file, stat_file, ddy_file; plug-in component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
jitter = Jitter(List=series, Jitter=1, Seed=c_script.A)  # -> Values, Indices
jitter_2 = Jitter(List=series_2, Jitter=1, Seed=c_script.A)  # -> Values, Indices
jitter_3 = Jitter(List=series_3, Jitter=1, Seed=c_script.A)  # -> Values, Indices
day = ListItem(List=jitter_2.Values, Index=0, Wrap=True)
hour = ListItem(List=jitter_3.Values, Index=0, Wrap=True)
month = ListItem(List=jitter.Values, Index=0, Wrap=True)
wea = HBWeaFromEPW(epw_file=downloadepw.epw_file)  # -> wea; plug-in component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
climatebased = HBClimatebasedSky(wea=wea, month=month, day=day, hour=hour)  # -> sky; plug-in component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
radpar = HBRadianceParameter(recipe_type=Slider(1, range=0..1))  # -> rad_par; plug-in component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
decnstrwea = HoneybeePlus_DeconstructWea(wea=wea)  # -> dir, diff, glob; plug-in component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
unit_x = UnitX(Factor=Slider(13, range=0..100))

# ---- group: Model
number_slider = Slider(3, range=0..10)
rectangle = Rectangle(Plane=PlaneXY(0, 0, 0), XSize=Slider(10, range=0..100), YSize=Slider(8, range=0..10), Radius=0)  # -> Rectangle, Length
box_rectangle = BoxRectangle(Rectangle=rectangle.Rectangle, Height=number_slider)
deconstruct_brep = DeconstructBrep(Brep=box_rectangle)  # -> Faces, Edges, Vertices
list_item = ListItem(List=deconstruct_brep.Faces, Index=0, Wrap=True)  # -> Item, Item1, Item2, Item3, Item4, Item5
area = Area(Geometry=list_item.Item)  # -> Area, Centroid
scale = Scale(Geometry=list_item.Item, Center=area.Centroid, Factor=Slider(0.9, range=0..1))  # -> Geometry, Transform
walls = Data([list_item.Item3, list_item.Item2, list_item.Item1])
floor = Data(list_item.Item4)
ceiling = Data(list_item.Item5)
window = Data(scale.Geometry)
panel_2 = Panel("floor")
panel_3 = Panel("ceiling")
panel_4 = Panel("0.8")
panel_5 = Panel("window")
panel_6 = Panel("0.79")
panel_7 = Panel("0.5")
panel_8 = Panel("0.2")
panel_9 = Panel("walls")

# ----
number_slider_2 = Slider(0.2, range=0..1)
deconstruct_brep_2 = DeconstructBrep(Brep=list_item.Item4)  # -> Faces, Edges, Vertices
unit_y = UnitY(Factor=expr("-x", number_slider_2))
list_item_2 = ListItem(List=deconstruct_brep_2.Edges, Index=0, Wrap=True)
move = Move(Geometry=list_item_2, Motion=unit_y)  # -> Geometry, Transform
unit_z = UnitZ(Factor=number_slider)
extrude = Extrude(Base=move.Geometry, Direction=unit_z)
unit_y_2 = UnitY(Factor=number_slider_2)
deconstruct_brep_3 = DeconstructBrep(Brep=extrude)  # -> Faces, Edges, Vertices
extrude_2 = Extrude(Base=deconstruct_brep_3.Edges, Direction=unit_y_2)

surface = Surface(list_item.Item)
opaquemod3_2 = HBOpaqueModifier3(name=panel_3, r_ref=panel_4, g_ref=panel_4, b_ref=panel_4)  # -> modifier; plug-in component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
opaquemod3_3 = HBOpaqueModifier3(name=panel_2, r_ref=panel_8, g_ref=panel_8, b_ref=panel_8)  # -> modifier; plug-in component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
glassmod3 = HBGlassModifier3(name=panel_5, r_trans=panel_6, g_trans=panel_6, b_trans=panel_6)  # -> modifier; plug-in component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
opaquemod3_4 = HBOpaqueModifier3(name=panel_9, r_ref=panel_7, g_ref=panel_7, b_ref=panel_7)  # -> modifier; plug-in component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
aperture = HBAperture(geo=window, rad_mod=glassmod3)  # -> out, apertures; plug-in component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
face = HBFace(geo=ceiling, rad_mod=opaquemod3_2)  # -> out, faces; plug-in component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
face_2 = HBFace(geo=surface, rad_mod=opaquemod3)  # -> out, faces; plug-in component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
face_3 = HBFace(geo=floor, rad_mod=opaquemod3_3)  # -> out, faces; plug-in component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
face_4 = HBFace(geo=walls, rad_mod=opaquemod3_4)  # -> out, faces; plug-in component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
addsubface = HBAddSubface(hb_obj=flatten(face_2.faces), sub_faces=flatten(aperture.apertures))  # -> hb_obj; plug-in component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

# ---- group: Model (continued)
data = Data(flatten([addsubface, face_4.faces, face_3.faces, face.faces]))
room = HBRoom(faces=flatten(data), conditioned=True)  # -> out, room; plug-in component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

# ----
# 2-Attractor Point
dimensions = Dimensions(Surface=extrude)  # -> UDimension, VDimension
series_4 = Series(Start="0", Step="0.1", Count=expr("x*10+1", dimensions.VDimension))
series_5 = Series(Start="0", Step="0.1", Count=expr("x*10+1", dimensions.UDimension))
jitter_4 = Jitter(List=series_5, Jitter=1, Seed=expr("x*5", c_script.A))  # -> Values, Indices
jitter_5 = Jitter(List=series_4, Jitter=1, Seed=c_script.A)  # -> Values, Indices
list_item_3 = ListItem(List=jitter_4.Values, Index=0, Wrap=True)
list_item_4 = ListItem(List=jitter_5.Values, Index=0, Wrap=True)
construct_point = ConstructPoint(XCoordinate=list_item_3, YCoordinate=expr("-x", list_item_4), ZCoordinate=0)
panel_10 = Panel(construct_point)
evaluate_surface = EvaluateSurface(Surface=extrude, Point=construct_point)  # -> Point, Normal, UDirection, VDirection, Frame

# ----
# Shade
deconstruct_brep_4 = DeconstructBrep(Brep=extrude_2)  # -> Faces, Edges, Vertices
discontinuity = Discontinuity(Curve=deconstruct_brep_4.Edges, Level=1)  # -> flatten(Points), Parameters
list_item_5 = ListItem(List=flatten(deconstruct_brep_4.Edges), Index="15", Wrap=True)
length = Length(Curve=list_item_5)
list_item_6 = ListItem(List=discontinuity.Points, Index="21", Wrap=True)
number_slider_3 = Slider(30, range=0..100)
multiplication = Multiplication(A=length, B=Slider(1, range=0..1))
xz = XZPlane(Origin=Point(0, 0, 0))
move_2 = Move(Geometry=xz, Motion=list_item_6)  # -> Geometry, Transform
division = Division(A=multiplication, B=number_slider_3)
sqgrid = Square(Plane=move_2.Geometry, Size=division, ExtentX=number_slider_3, ExtentY=Slider(9, range=0..10))  # -> simplify(Cells), Points
flip = FlipMatrix(Data=sqgrid.Cells)
X = UnitX(Factor=1)
explode = Explode(Curve=flip, Recursive=True)  # -> Segments, Vertices
area_2 = Area(Geometry=flip)  # -> Area, Centroid
move_3 = Move(Geometry=area_2.Centroid, Motion=X)  # -> Geometry, Transform
midpt = CurveMiddle(Curve=explode.Segments)  # -> simplify(Midpoint)
ln = Line(StartPoint=area_2.Centroid, EndPoint=move_3.Geometry)
pln = Plane(area_2.Centroid)
ln_2 = Line(StartPoint=midpt, EndPoint=graft(area_2.Centroid))
cull_i = CullIndex(List=explode.Vertices, Indices="4", Wrap=True)
rotax = RotateAxis(Geometry=pln, Angle=degrees(Slider(90, range=0..100)), Axis=ln)  # -> Geometry, Transform
ln_3 = Line(StartPoint=cull_i, EndPoint=graft(area_2.Centroid))
pt = Point(evaluate_surface.Point)
multiplication_2 = Multiplication(A=division, B=Slider(0.5, range=0..1))
pt_2 = Point(flatten(area_2.Centroid))
rectangle_2 = Rectangle(Plane=rotax.Geometry, XSize=multiplication_2, YSize=multiplication_2, Radius=0)  # -> Rectangle, Length
symsim = SymbolSimple(
    Style=Slider(6, range=0..10),
    Size=Slider(10, range=0..10),
    Rotation=0,
    Colour=ColourSwatch(SwatchColor=RGB(114, 77, 255)))
cp = ClosestPoint(Point=pt_2, Cloud=pt)  # -> ClosestPoint, CPIndex, Distance
arrpolar = PolarArray(Geometry=rectangle_2.Rectangle, Plane=rotax.Geometry, Count="4", Angle=degrees("360"))  # -> Geometry, Transform
symbol = SymbolDisplay(Location=pt, Display=symsim)
bnd = Bounds(Numbers=cp.Distance)
dom = ConstructDomain(DomainStart="-45", DomainEnd="0")
shift = ShiftList(List=arrpolar.Geometry, Shift="2", Wrap=True)
remap = RemapNumbers(Value=cp.Distance, Source=bnd, Target=dom)  # -> Mapped, Clipped
mesh = MeshBrep(
    Brep=shift,
    Settings={GridMaxCount=0, GridMinCount=16, JaggedSeams=False, MaxEdgeLength=0, MinEdgeLength=0.0001, MinTolerance=0, Refine=True, RefineAngle=0, RelativeTolerance=0.65, SimplePlanes=True, Tolerance=0})
graph = GraphMapper(
    remap.Mapped,
    x0=-45,
    x1=0,
    y0=-45,
    y1=0,
    container_name="Bezier",
    cpx=[0, 0.1126938984, 0.2515922189, 1],
    cpy=[0, 0.4569168687, 1, 1])
tri = Triangulate(Mesh=mesh)  # -> Mesh, Count
faceb = FaceBoundaries(Mesh=tri.Mesh)
dup = DuplicateData(Data=graph, Number=Slider(1, range=0..10), Order=Toggle(False))  # -> graft(Data)
trim = TrimTree(Tree=faceb, Depth=Slider(1, range=0..10))
dispatch = Dispatch(List=trim, DispatchPattern=[True, False])  # -> ListA, ListB
expression = Expression(x=dup, Expression="If((x≥-30),x,-30)")
neg = Negative(Value=expression)
rotax_2 = RotateAxis(Geometry=dispatch.ListA, Angle=expr("x*3", degrees(neg)), Axis=ln_3)  # -> Geometry, Transform
rotax_3 = RotateAxis(Geometry=dispatch.ListB, Angle=expr("x*3", degrees(expression)), Axis=ln_3)  # -> Geometry, Transform
shift_2 = ShiftList(List=ln_3, Shift="1", Wrap=True)
partition = PartitionList(List=dup, Size="4")
rotax_4 = RotateAxis(Geometry=rotax_3.Geometry, Angle=degrees(partition), Axis=shift_2)  # -> Geometry, Transform
rotax_5 = RotateAxis(Geometry=rotax_2.Geometry, Angle=degrees(partition), Axis=shift_2)  # -> Geometry, Transform
merge = Merge(Data1=rotax_5.Geometry, Data2=rotax_4.Geometry)
boundary = BoundarySurfaces(Edges=merge)
move_4 = Move(Geometry=boundary, Motion=list_item_6)  # -> Geometry, Transform

colour_swatch = ColourSwatch(SwatchColor=RGB(242, 215, 141))
split_argb = SplitARGB(Colour=colour_swatch)  # -> Alpha, Red, Green, Blue
preview = CustomPreview(Geometry=move_4.Geometry, Material=colour_swatch)
multiplication_3 = Multiplication(A=split_argb.Red, B="0.265")
multiplication_4 = Multiplication(A=split_argb.Green, B="0.670")
multiplication_5 = Multiplication(A=split_argb.Blue, B="0.065")
subtraction = Subtraction(A="0.11", B="0.5")
panel_11 = Panel("0")
transmod3 = HBTranslucentModifier3(
    name="shading_Aurora",
    r_diff_ref=multiplication_3,
    g_diff_ref=multiplication_4,
    b_diff_ref=multiplication_5,
    diff_trans="0.2",
    rough="0.2")  # -> modifier; plug-in component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
opaquemod3_5 = HBOpaqueModifier3(name="Structural Frames", r_ref="0.3", g_ref="0.3", b_ref="0.3", spec="0.1", rough="0")  # -> modifier; plug-in component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
shade = HBShade(geo=extrude_2, rad_mod=opaquemod3_5)  # -> out, shades; plug-in component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
shade_2 = HBShade(geo=move_4.Geometry, rad_mod=transmod3)  # -> out, shades; plug-in component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
addshade = HBAddShade(hb_obj=room.room, out_shades=flatten([shade_2.shades, shade.shades]))  # -> hb_obj; plug-in component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
model = HBModel(rooms=flatten(addshade))  # -> out, model; plug-in component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

vizbytype = HBVisualizeByType(hb_objs=model.model)  # -> walls, interior_walls, roofs, ceilings, exterior_floors, interior_floors, air_walls, apertures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; plug-in component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

# ----
# 4-Et
panel_12 = Panel("0.4")
gridrooms = HBSensorGridFromRooms(rooms=model.model, grid_size=panel_12, dist_floor="0.8")  # -> grid, points, mesh; plug-in component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
assigngridsviews = HBAssignGridsAndViews(model=model.model, grids=flatten(gridrooms.grid))  # -> model; plug-in component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
recipesettings = HBRecipeSettings(reload_old=False)  # -> settings; plug-in component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
pitgrid = HBPointInTimeGridBased(model=assigngridsviews, sky=climatebased, run_settings=recipesettings, run=Toggle(False))  # -> out, results; plug-in component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

# ----
# 5-Ev
panel_13 = Panel("1.15")
gridrooms_2 = HBSensorGridFromRooms(rooms=model.model, grid_size=panel_12, dist_floor=panel_13)  # -> grid, points, mesh; plug-in component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
sensorgrid = HBRadialSensorGrid(positions=gridrooms_2.points, dir_count="1", start_vec="0,-1,0")  # -> grid, points, vecs, mesh; plug-in component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
assigngridsviews_2 = HBAssignGridsAndViews(model=model.model, grids=flatten(sensorgrid.grid))  # -> model; plug-in component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
vector_display = VectorDisplay(Anchor=sensorgrid.points, Vector=sensorgrid.vecs)
pitgrid_2 = HBPointInTimeGridBased(model=assigngridsviews_2, sky=climatebased, run=Toggle(False))  # -> out, results; plug-in component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

# ----
# 1-Distances
unit_z_2 = UnitZ(Factor="0.8")
brep = Brep(floor)
move_5 = Move(Geometry=brep, Motion=unit_z_2)  # -> Geometry, Transform
deconstruct_brep_5 = DeconstructBrep(Brep=move_5.Geometry)  # -> Faces, graft(Edges), Vertices
pull_point = PullPoint(Point=gridrooms.points, Geometry=deconstruct_brep_5.Edges, ClosestOnly=True)  # -> ClosestPoint, Distance
flip_matrix = FlipMatrix(Data=pull_point.Distance)
line = Line(StartPoint=evaluate_surface.Point, EndPoint=gridrooms.points)
length_2 = Length(Curve=line)
list_item_7 = ListItem(List=flip_matrix, Index=0, Wrap=True)  # -> flatten(Item), flatten(Item1), flatten(Item2), flatten(Item3)

heatmap = LBSpatialHeatmap(values=pitgrid_2.results, mesh=gridrooms_2.mesh, legend_title="lux", global_title="Vertical Eye Illuminance (Ev)")  # -> mesh, legend, title, colors, legend_par, vis_set; plug-in component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
heatmap_2 = LBSpatialHeatmap(values=pitgrid.results, mesh=gridrooms.mesh, legend_title="lux", global_title="Task Illuminance (Et)")  # -> mesh, legend, title, colors, legend_par, vis_set; plug-in component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
move_6 = Move(Geometry=[heatmap_2.mesh, heatmap_2.legend, heatmap_2.title], Motion=unit_x)  # -> Geometry, Transform

# ----
# 3-Sky
importepw = LBImportEPW(epw_file=downloadepw.epw_file)  # -> location, dry_bulb_temperature, dew_point_temperature, relative_humidity, wind_speed, wind_direction, direct_normal_rad, diffuse_horizontal_rad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; plug-in component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
analysisperiod = LBAnalysisPeriod(start_month=month, start_day=day, start_hour=hour, end_month=month, end_day=day, end_hour=hour)  # -> period, hoys, dates; plug-in component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
importloc = LBImportLocation(epw_file=downloadepw.epw_file)  # -> location; plug-in component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
applyper = LBApplyAnalysisPeriod(data=importepw.total_sky_cover, period=analysisperiod.period)  # -> data; plug-in component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
applyper_2 = LBApplyAnalysisPeriod(data=importepw.global_horizontal_ill, period=analysisperiod.period)  # -> data; plug-in component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
xdata = LBDeconstructData(data=applyper)  # -> header, values; plug-in component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
xdata_2 = LBDeconstructData(data=applyper_2)  # -> header, values; plug-in component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
panel_14 = Panel(xdata.values)
panel_15 = Panel(xdata_2.values)

sunpath = LBSunPath(location=importloc, hoys=analysisperiod.hoys, scale=1)  # -> report, vectors, altitudes, azimuths, hoys, sun_pts, analemma, daily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; plug-in component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

panel_16 = Panel(sunpath.altitudes)
panel_17 = Panel(sunpath.azimuths)

applyper_3 = LBApplyAnalysisPeriod(data=decnstrwea.diff, period=analysisperiod.period)  # -> data; plug-in component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
applyper_4 = LBApplyAnalysisPeriod(data=decnstrwea.dir, period=analysisperiod.period)  # -> data; plug-in component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
applyper_5 = LBApplyAnalysisPeriod(data=decnstrwea.glob, period=analysisperiod.period)  # -> data; plug-in component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
xdata_3 = LBDeconstructData(data=applyper_3)  # -> header, values; plug-in component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
xdata_4 = LBDeconstructData(data=applyper_5)  # -> header, values; plug-in component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
xdata_5 = LBDeconstructData(data=applyper_4)  # -> header, values; plug-in component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
panel_18 = Panel(xdata_3.values)
panel_19 = Panel(xdata_4.values)
panel_20 = Panel(xdata_5.values)

random_reduce = RandomReduce(List=list_item_7.Item2, Reduction="400", Seed=1)
random_reduce_2 = RandomReduce(List=list_item_7.Item1, Reduction="400", Seed=1)
random_reduce_3 = RandomReduce(List=list_item_7.Item, Reduction="400", Seed=1)
random_reduce_4 = RandomReduce(List=length_2, Reduction="400", Seed=1)
random_reduce_5 = RandomReduce(List=list_item_7.Item3, Reduction="400", Seed=1)
duplicate_data = DuplicateData(Data=list_item_4, Number="100", Order=True)
duplicate_data_2 = DuplicateData(Data=list_item_3, Number="100", Order=True)
duplicate_data_3 = DuplicateData(Data=panel_19, Number="100", Order=True)
duplicate_data_4 = DuplicateData(Data=panel_14, Number="100", Order=True)
duplicate_data_5 = DuplicateData(Data=panel_17, Number="100", Order=True)
random_reduce_6 = RandomReduce(List=pitgrid.results, Reduction="400", Seed=1)
duplicate_data_6 = DuplicateData(Data=panel_16, Number="100", Order=True)
random_reduce_7 = RandomReduce(List=pitgrid_2.results, Reduction="400", Seed=1)
panel_21 = Panel(""" SP-Soth-Dis
 SP-East-Dis
 SP-North-Dis
 SP-West-Dis
SP-Ap-Dis
AP-Length
AP-Width
Dir-wea
Diff-wea
glob-wea
Total-Sky-cover
Altitude
Azimuth
Et
Ev""")

duplicate_data_7 = DuplicateData(Data=panel_20, Number="100", Order=True)
duplicate_data_8 = DuplicateData(Data=panel_18, Number="100", Order=True)

entwine = Entwine(
    Branch00=random_reduce_3,
    Branch01=random_reduce_2,
    Branch02=random_reduce,
    Branch03=random_reduce_5,
    Branch04=random_reduce_4,
    Branch05=duplicate_data,
    Branch06=duplicate_data_2,
    Branch07=duplicate_data_7,
    Branch08=duplicate_data_8,
    Branch09=duplicate_data_3,
    Branch010=duplicate_data_4,
    Branch011=duplicate_data_6,
    Branch012=duplicate_data_5,
    Branch013=random_reduce_6,
    Branch014=random_reduce_7,
    FlattenInputs=True)
param_viewer = ParamViewer(entwine)
null_item = NullItem(Item=entwine)  # -> NullFlags, InvalidFlags, Description
pick_n_choose = PickNChoose(Pattern=null_item.NullFlags, Stream0=entwine, Stream1="Error")
create_csv = CreateCSV(DataGridHeaders=panel_21, ValueTree=pick_n_choose, Delimiter=",")

data_recorder = DataRecorder(create_csv, DataLimit=-10, RecordData=True)

panel_22 = Panel(data_recorder)
