# Grasshopper definition Daylight Final+heatmap.gh (Grasshopper 1.0.8)
# plug-ins: Kangaroo Components, LunchBox

button = Button()
trigger = Trigger(Interval=5000, TimerInterval=5000, Target=[counter, c_script])  # disabled
c_script = CSharpScript(reset=button)  # -> out, A; inputs reset: Boolean
# ---------- c_script: C# ----------
    if(reset)i = 0; else i++;
    A = i;
# ---------- c_script: C# additional code ----------
  int i;
# ---------- end c_script ----------
counter = Counter(Reset=button)
addition = Addition(A="0", B=c_script.A)
number_slider = Slider(0.1, range=0..1)  # disabled
number_slider_2 = Slider(0.5, range=0..1)  # disabled
number_slider_3 = Slider(0.3, range=0..1)  # disabled
number_slider_4 = Slider(0.1, range=0..0.1)  # disabled
transmod3 = HBTranslucentModifier3(
    r_diff_ref=number_slider_2,
    g_diff_ref=number_slider_2,
    b_diff_ref=number_slider_2,
    diff_trans=number_slider_3,
    spec_trans=number_slider,
    rough=number_slider_4)  # -> modifier; disabled; plug-in component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
number_slider_5 = Slider(0.3, range=0..1)
number_slider_6 = Slider(0.05, range=0..0.1)
number_slider_7 = Slider(0.01, range=0..0.01)
transmod3_2 = HBTranslucentModifier3(
    r_diff_ref=number_slider_5,
    g_diff_ref=number_slider_5,
    b_diff_ref=number_slider_5,
    diff_trans=Slider(0.5, range=0..1),
    spec_trans=Slider(0.1, range=0..1),
    rough=Slider(0.1, range=0..0.1))  # -> modifier; plug-in component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
opaquemod3 = HBOpaqueModifier3(name="walls", r_ref="0.5", g_ref="0.5", b_ref="0.5")  # -> modifier; plug-in component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
panel = Panel("Attractor point length: ")  # disabled
panel_2 = Panel("Attractor point width: ")  # disabled
point = Point(Point(0, -2.546003802, 0))  # disabled
point_2 = Point(Point(5.923009636, -2.546003802, 0))  # disabled
number_slider_8 = Slider(0.3, range=0..1)  # disabled
panel_3 = Panel("Black")  # disabled
epwmap = LBEPWmap(epw_map=Toggle(False))  # -> Output; plug-in component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
# Test
# Northwest (Seattle, WA) → Vancouver, Canada 🇨🇦
# West (Los Angeles, CA) → Lisbon, Portugal 🇵🇹
# Southwest (Phoenix, AZ) → Madrid, Spain 🇪🇸
# Northern Rockies and Plains (Denver, CO) → Ulaanbaatar, Mongolia 🇲🇳
# Upper Midwest (Minneapolis, MN) → Stockholm, Sweden 🇸🇪
# Ohio Valley (Chicago, IL) → Warsaw, Poland 🇵🇱
# Northeast (New York City, NY) → London, United Kingdom 🇬🇧
# South (Houston, TX) → Shanghai, China 🇨🇳
# Southeast (Atlanta, GA) → Tokyo, Japan 🇯🇵
panel_4 = Panel("https://climate.onebuilding.org/WMO_Region_4_North_and_Central_America/CAN_Canada/BC_British_Columbia/CAN_BC_Vancouver.Harbour.CS.712010_TMYx.2004-2018.zip")
panel_5 = Panel("https://climate.onebuilding.org/WMO_Region_6_Europe/PRT_Portugal/LB_Lisboa/PRT_LB_Lisboa-Geof.085350_TMYx.zip")
panel_6 = Panel("https://energyplus-weather.s3.amazonaws.com/europe_wmo_region_6/ESP/ESP_Madrid.082210_SWEC/ESP_Madrid.082210_SWEC.zip")
panel_7 = Panel("https://energyplus-weather.s3.amazonaws.com/asia_wmo_region_2/CHN/CHN_Shanghai.Shanghai.583670_IWEC/CHN_Shanghai.Shanghai.583670_IWEC.zip")
panel_8 = Panel("https://energyplus-weather.s3.amazonaws.com/asia_wmo_region_2/MNG/MNG_Ulaanbataar.442920_IWEC/MNG_Ulaanbataar.442920_IWEC.zip")
panel_9 = Panel("https://climate.onebuilding.org/WMO_Region_2_Asia/JPN_Japan/TK_Tokyo/JPN_TK_Tokyo.476620_JGMY.zip")
panel_10 = Panel("https://energyplus-weather.s3.amazonaws.com/europe_wmo_region_6/POL/POL_Warsaw.123750_IWEC/POL_Warsaw.123750_IWEC.zip")
panel_11 = Panel("https://climate.onebuilding.org/WMO_Region_6_Europe/SWE_Sweden/ST_Stockholm/SWE_ST_Stockholm.024850_TMYx.zip")
panel_12 = Panel("https://climate.onebuilding.org/WMO_Region_6_Europe/GBR_United_Kingdom/ENG_England/GBR_ENG_London.Wea.Ctr-St.James.Park.037700_TMYx.zip")
merge = Merge(
    Data1=panel_4,
    Data2=panel_5,
    Data3=panel_6,
    Data4=panel_8,
    Data5=panel_11,
    Data6=panel_10,
    Data7=panel_12,
    Data8=panel_7,
    Data9=panel_9)
panel_13 = Panel("https://energyplus-weather.s3.amazonaws.com/north_and_central_america_wmo_region_4/USA/NY/USA_NY_New.York.City-Central.Park.94728_TMY/USA_NY_New.York.City-Central.Park.94728_TMY.zip")
panel_14 = Panel("https://climate.onebuilding.org/WMO_Region_4_North_and_Central_America/USA_United_States_of_America/IL_Illinois/USA_IL_Chicago-Meigs.Field-Northerly.Island.725346_TMYx.zip")
panel_15 = Panel("https://energyplus-weather.s3.amazonaws.com/north_and_central_america_wmo_region_4/USA/GA/USA_GA_Atlanta-Hartsfield-Jackson.Intl.AP.722190_TMY/USA_GA_Atlanta-Hartsfield-Jackson.Intl.AP.722190_TMY.zip")
panel_16 = Panel("https://climate.onebuilding.org/WMO_Region_4_North_and_Central_America/USA_United_States_of_America/TX_Texas/USA_TX_Houston-Dunn.Heli.720594_TMYx.zip")
panel_17 = Panel("https://energyplus-weather.s3.amazonaws.com/north_and_central_america_wmo_region_4/USA/AZ/USA_AZ_Phoenix.722780_TMY2/USA_AZ_Phoenix.722780_TMY2.zip")
panel_18 = Panel("https://climate.onebuilding.org/WMO_Region_4_North_and_Central_America/USA_United_States_of_America/CO_Colorado/USA_CO_Denver-Lowry.AFB.724691_TMYx.zip")
panel_19 = Panel("https://climate.onebuilding.org/WMO_Region_4_North_and_Central_America/USA_United_States_of_America/MN_Minnesota/USA_MN_Minneapolis-St.Paul.Intl.AP.726580_US.Normals.2006-2020.zip")
panel_20 = Panel("https://climate.onebuilding.org/WMO_Region_4_North_and_Central_America/California_Climate_Zones/California_CTZ_2016/USA_CA_Los.Angeles.Downtown.722874_CTZ2016.zip")
# Train
# Here are the most populous cities representative of each U.S. climate region shown in the image:
# 
# Northwest – Seattle, Washington
# West – Los Angeles, California
# Southwest – Phoenix, Arizona
# Northern Rockies and Plains – Denver, Colorado
# Upper Midwest – Minneapolis, Minnesota
# Ohio Valley – Chicago, Illinois
# Northeast – New York City, New York
# South – Houston, Texas
# Southeast – Atlanta, Georgia
# https://www.ncei.noaa.gov/access/monitoring/reference-maps/us-climate-regions
panel_21 = Panel("https://climate.onebuilding.org/WMO_Region_4_North_and_Central_America/USA_United_States_of_America/WA_Washington/USA_WA_Seattle.994014_TMYx.zip")
merge_2 = Merge(
    Data1=panel_21,
    Data2=panel_20,
    Data3=panel_17,
    Data4=panel_18,
    Data5=panel_19,
    Data6=panel_14,
    Data7=panel_13,
    Data8=panel_16,
    Data9=panel_15)
epwmap_2 = LBEPWmap(epw_map=Toggle(False))  # -> Output; disabled; plug-in component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
# Northwest – Seattle, Washington
# West – Los Angeles, California
# Southwest – Phoenix, Arizona
# Northern Rockies and Plains – Denver, Colorado
# Upper Midwest – Minneapolis, Minnesota
# Ohio Valley – Chicago, Illinois
# Northeast – New York City, New York
# South – Houston, Texas
# Southeast – Atlanta, Georgia
list_item = ListItem(List=panel_15, Index=0, Wrap=True)  # disabled
number_slider_9 = Slider(20, range=0..100)  # disabled
number_slider_10 = Slider(25, range=0..100)  # disabled
number_slider_11 = Slider(35, range=0..100)  # disabled
number_slider_12 = Slider(50, range=0..100)  # disabled
number_slider_13 = Slider(5, range=0..100)  # disabled
number_slider_14 = Slider(74, range=0..100)  # disabled
downloadepw = LBDownloadWeather(weather_URL=list_item)  # -> epw_file, stat_file, ddy_file; disabled; plug-in component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
panel_22 = Panel("-118")  # disabled
wea = HBWeaFromEPW(epw_file=downloadepw.epw_file)  # -> wea; disabled; plug-in component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
constrloc = LBConstructLocation(latitude=number_slider_11, longitude=panel_22, elevation=0)  # -> location; disabled; plug-in component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
panel_23 = Panel("17")  # disabled
panel_24 = Panel("9")  # disabled
panel_25 = Panel("1")  # disabled
panel_26 = Panel("12")  # disabled
panel_27 = Panel("1")  # disabled
panel_28 = Panel("31")  # disabled

panel_29 = Panel("m/s")  # disabled
panel_30 = Panel("Wind")  # disabled
constrtype = LBConstructDataType(name=panel_30, unit=panel_29)  # -> type; disabled; plug-in component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
panel_31 = Panel("8760")  # disabled
constrheader = LBConstructHeader(data_type=constrtype)  # -> header; disabled; plug-in component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
duplicate_data = DuplicateData(Data=number_slider_9, Number=panel_31, Order=True)  # disabled
data = LBConstructData(header=constrheader, values=duplicate_data)  # -> data; disabled; plug-in component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

panel_32 = Panel("m/s")  # disabled
panel_33 = Panel("Wind")  # disabled
constrtype_2 = LBConstructDataType(name=panel_33, unit=panel_32)  # -> type; disabled; plug-in component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
panel_34 = Panel("8760")  # disabled
constrheader_2 = LBConstructHeader(data_type=constrtype_2)  # -> header; disabled; plug-in component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
duplicate_data_2 = DuplicateData(Data=number_slider_10, Number=panel_34, Order=True)  # disabled
data_2 = LBConstructData(header=constrheader_2, values=duplicate_data_2)  # -> data; disabled; plug-in component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

panel_35 = Panel("m/s")  # disabled
panel_36 = Panel("Wind")  # disabled
constrtype_3 = LBConstructDataType(name=panel_36, unit=panel_35)  # -> type; disabled; plug-in component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
panel_37 = Panel("8760")  # disabled
constrheader_3 = LBConstructHeader(data_type=constrtype_3)  # -> header; disabled; plug-in component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
duplicate_data_3 = DuplicateData(Data=number_slider_13, Number=panel_37, Order=True)  # disabled
data_3 = LBConstructData(header=constrheader_3, values=duplicate_data_3)  # -> data; disabled; plug-in component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

panel_38 = Panel("m/s")  # disabled
panel_39 = Panel("Wind")  # disabled
constrtype_4 = LBConstructDataType(name=panel_39, unit=panel_38)  # -> type; disabled; plug-in component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
panel_40 = Panel("8760")  # disabled
constrheader_4 = LBConstructHeader(data_type=constrtype_4)  # -> header; disabled; plug-in component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
duplicate_data_4 = DuplicateData(Data=number_slider_12, Number=panel_40, Order=True)  # disabled
data_4 = LBConstructData(header=constrheader_4, values=duplicate_data_4)  # -> data; disabled; plug-in component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

jitter = Jitter(List=merge, Jitter=1, Seed=addition)  # -> Values, Indices
analysisperiod = LBAnalysisPeriod(start_month=panel_25, start_day=panel_27, start_hour=panel_24, end_month=panel_26, end_day=panel_28, end_hour=panel_23)  # -> period, hoys, dates; disabled; plug-in component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
decnstrwea = HoneybeePlus_DeconstructWea(wea=wea)  # -> dir, diff, glob; disabled; plug-in component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
list_item_2 = ListItem(List=jitter.Values, Index=0, Wrap=True)
python_3_script = Python3Script(x=list_item_2)  # -> out, y
# ---------- python_3_script: Python ----------
if x == "https://climate.onebuilding.org/WMO_Region_4_North_and_Central_America/USA_United_States_of_America/WA_Washington/USA_WA_Seattle.994014_TMYx.zip":

    y = "Seattle"

elif x == "https://climate.onebuilding.org/WMO_Region_4_North_and_Central_America/California_Climate_Zones/California_CTZ_2016/USA_CA_Los.Angeles.Downtown.722874_CTZ2016.zip":

    y = "Los_Angeles"

elif x == "https://energyplus-weather.s3.amazonaws.com/north_and_central_america_wmo_region_4/USA/AZ/USA_AZ_Phoenix.722780_TMY2/USA_AZ_Phoenix.722780_TMY2.zip":

    y = "Phoenix"

elif x == "https://climate.onebuilding.org/WMO_Region_4_North_and_Central_America/USA_United_States_of_America/CO_Colorado/USA_CO_Denver-Lowry.AFB.724691_TMYx.zip":

    y = "Denver"

elif x == "https://climate.onebuilding.org/WMO_Region_4_North_and_Central_America/USA_United_States_of_America/MN_Minnesota/USA_MN_Minneapolis-St.Paul.Intl.AP.726580_US.Normals.2006-2020.zip":

    y = "Minneapolis"

elif x == "https://climate.onebuilding.org/WMO_Region_4_North_and_Central_America/USA_United_States_of_America/IL_Illinois/USA_IL_Chicago-Meigs.Field-Northerly.Island.725346_TMYx.zip":

    y = "Chicago"

elif x == "https://energyplus-weather.s3.amazonaws.com/north_and_central_america_wmo_region_4/USA/NY/USA_NY_New.York.City-Central.Park.94728_TMY/USA_NY_New.York.City-Central.Park.94728_TMY.zip":

    y = "New_york"

elif x == "https://climate.onebuilding.org/WMO_Region_4_North_and_Central_America/USA_United_States_of_America/TX_Texas/USA_TX_Houston-Dunn.Heli.720594_TMYx.zip":

    y = "Houston"

elif x == "https://energyplus-weather.s3.amazonaws.com/north_and_central_america_wmo_region_4/USA/GA/USA_GA_Atlanta-Hartsfield-Jackson.Intl.AP.722190_TMY/USA_GA_Atlanta-Hartsfield-Jackson.Intl.AP.722190_TMY.zip":

    y = "Atlanta"

else:

    y = "error"
# ---------- end python_3_script ----------
python_3_script_2 = Python3Script(x=list_item_2)  # -> out, y
# ---------- python_3_script_2: Python ----------
if x == "https://climate.onebuilding.org/WMO_Region_4_North_and_Central_America/CAN_Canada/BC_British_Columbia/CAN_BC_Vancouver.Harbour.CS.712010_TMYx.2004-2018.zip":

    y = "Vancouver"

elif x == "https://climate.onebuilding.org/WMO_Region_6_Europe/PRT_Portugal/LB_Lisboa/PRT_LB_Lisboa-Geof.085350_TMYx.zip":

    y = "Lisbon"

elif x == "https://energyplus-weather.s3.amazonaws.com/europe_wmo_region_6/ESP/ESP_Madrid.082210_SWEC/ESP_Madrid.082210_SWEC.zip":

    y = "Madrid"

elif x == "https://energyplus-weather.s3.amazonaws.com/asia_wmo_region_2/MNG/MNG_Ulaanbataar.442920_IWEC/MNG_Ulaanbataar.442920_IWEC.zip":

    y = "Ulaanbaatar"

elif x == "https://climate.onebuilding.org/WMO_Region_6_Europe/SWE_Sweden/ST_Stockholm/SWE_ST_Stockholm.024850_TMYx.zip":

    y = "Stockholm"

elif x == "https://energyplus-weather.s3.amazonaws.com/europe_wmo_region_6/POL/POL_Warsaw.123750_IWEC/POL_Warsaw.123750_IWEC.zip":

    y = "Warsaw"

elif x == "https://climate.onebuilding.org/WMO_Region_6_Europe/GBR_United_Kingdom/ENG_England/GBR_ENG_London.Wea.Ctr-St.James.Park.037700_TMYx.zip":

    y = "London"

elif x == "https://energyplus-weather.s3.amazonaws.com/asia_wmo_region_2/CHN/CHN_Shanghai.Shanghai.583670_IWEC/CHN_Shanghai.Shanghai.583670_IWEC.zip":

    y = "Shanghai"

elif x == "https://climate.onebuilding.org/WMO_Region_2_Asia/JPN_Japan/TK_Tokyo/JPN_TK_Tokyo.476620_JGMY.zip":

    y = "Tokyo"

else:

    y = "error"
# ---------- end python_3_script_2 ----------
applyper = LBApplyAnalysisPeriod(data=decnstrwea.glob, period=analysisperiod.period)  # -> data; disabled; plug-in component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
applyper_2 = LBApplyAnalysisPeriod(data=decnstrwea.diff, period=analysisperiod.period)  # -> data; disabled; plug-in component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
applyper_3 = LBApplyAnalysisPeriod(data=decnstrwea.dir, period=analysisperiod.period)  # -> data; disabled; plug-in component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
panel_41 = Panel(python_3_script_2.y)
importloc = LBImportLocation(epw_file=downloadepw.epw_file)  # -> location; disabled; plug-in component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
series = Series(Start="1", Step="1", Count="12")
series_2 = Series(Start="1", Step="1", Count="31")
series_3 = Series(Start="9", Step="1", Count="9")
xdata = LBDeconstructData(data=applyper)  # -> header, values; disabled; plug-in component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
xdata_2 = LBDeconstructData(data=applyper_2)  # -> header, values; disabled; plug-in component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
xdata_3 = LBDeconstructData(data=applyper_3)  # -> header, values; disabled; plug-in component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
downloadepw_2 = LBDownloadWeather(weather_URL=list_item_2)  # -> epw_file, stat_file, ddy_file; plug-in component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
jitter_2 = Jitter(List=series_2, Jitter=1, Seed=expr("x*76", addition))  # -> Values, Indices
jitter_3 = Jitter(List=series, Jitter=1, Seed=addition)  # -> Values, Indices
jitter_4 = Jitter(List=series_3, Jitter=1, Seed=addition)  # -> Values, Indices
bounds = Bounds(Numbers=xdata_2.values)  # disabled
bounds_2 = Bounds(Numbers=xdata_3.values)  # disabled
bounds_3 = Bounds(Numbers=xdata.values)  # disabled
day = ListItem(List=jitter_2.Values, Index=0, Wrap=True)
hour = ListItem(List=jitter_4.Values, Index=0, Wrap=True)
month = ListItem(List=jitter_3.Values, Index=0, Wrap=True)
zhang_huang = HBWeaFromZhangHuang(location=constrloc, cloud_cover=data_3, rel_humidity=data_4, dry_bulb_temp=data_2, wind_speed=data)  # -> wea; disabled; plug-in component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
panel_42 = Panel(bounds)  # disabled
panel_43 = Panel(bounds_2)  # disabled
panel_44 = Panel(bounds_3)  # disabled
wea_2 = HBWeaFromEPW(epw_file=downloadepw_2.epw_file)  # -> wea; plug-in component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
sunpath = LBSunPath(location=importloc, hoys=analysisperiod.hoys, scale=1)  # -> report, vectors, altitudes, azimuths, hoys, sun_pts, analemma, daily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; disabled; plug-in component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
bounds_4 = Bounds(Numbers=sunpath.azimuths)  # disabled
bounds_5 = Bounds(Numbers=sunpath.altitudes)  # disabled
climatebased = HBClimatebasedSky(wea=wea_2, month=month, day=day, hour=hour)  # -> sky; plug-in component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
decnstrwea_2 = HoneybeePlus_DeconstructWea(wea=zhang_huang)  # -> dir, diff, glob; plug-in component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
entwine = Entwine(
    Branch00=list_item,
    Branch01=panel_43,
    Branch02=panel_42,
    Branch03=panel_44,
    Branch04=bounds_5,
    Branch05=bounds_4,
    FlattenInputs=True)  # disabled
panel_45 = Panel(bounds_4)  # disabled
panel_46 = Panel(bounds_5)  # disabled
panel_47 = Panel("""City
Dir_wea
Diff_wae
Glob_wea
Altitudes
Azimuths""")  # disabled
create_csv = CreateCSV(DataGridHeaders=panel_47, ValueTree=entwine, Delimiter=",")  # disabled
radpar = HBRadianceParameter(recipe_type=Slider(1, range=0..1))  # -> rad_par; plug-in component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
data_recorder = DataRecorder(create_csv, DataLimit=-10, RecordData=True)  # disabled
panel_48 = Panel(data_recorder)  # disabled
number_slider_15 = Slider(13, range=0..100)  # disabled
decnstrwea_3 = HoneybeePlus_DeconstructWea(wea=wea_2)  # -> dir, diff, glob; plug-in component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
unit_x = UnitX(Factor=number_slider_15)  # disabled

# ---- group: Model
number_slider_16 = Slider(3, range=0..10)
rectangle = Rectangle(Plane=PlaneXY(0, 0, 0), XSize=Slider(10, range=0..100), YSize=Slider(8, range=0..10), Radius=0)  # -> Rectangle, Length
box_rectangle = BoxRectangle(Rectangle=rectangle.Rectangle, Height=number_slider_16)
deconstruct_brep = DeconstructBrep(Brep=box_rectangle)  # -> Faces, Edges, Vertices
list_item_3 = ListItem(List=deconstruct_brep.Faces, Index=0, Wrap=True)  # -> Item, Item1, Item2, Item3, Item4, Item5
area = Area(Geometry=list_item_3.Item)  # -> Area, Centroid
scale = Scale(Geometry=list_item_3.Item, Center=area.Centroid, Factor=Slider(0.9, range=0..1))  # -> Geometry, Transform
walls = Data([list_item_3.Item3, list_item_3.Item2, list_item_3.Item1])
floor = Data(list_item_3.Item4)
ceiling = Data(list_item_3.Item5)
window = Data(scale.Geometry)
panel_49 = Panel("floor")
panel_50 = Panel("ceiling")
panel_51 = Panel("0.8")
panel_52 = Panel("window")
panel_53 = Panel("0.79")
panel_54 = Panel("0.5")
panel_55 = Panel("0.2")
panel_56 = Panel("walls")

# ----
number_slider_17 = Slider(0.2, range=0..1)
deconstruct_brep_2 = DeconstructBrep(Brep=list_item_3.Item4)  # -> Faces, Edges, Vertices
unit_y = UnitY(Factor=expr("-x", number_slider_17))
list_item_4 = ListItem(List=deconstruct_brep_2.Edges, Index=0, Wrap=True)
move = Move(Geometry=list_item_4, Motion=unit_y)  # -> Geometry, Transform
unit_z = UnitZ(Factor=number_slider_16)
extrude = Extrude(Base=move.Geometry, Direction=unit_z)
unit_y_2 = UnitY(Factor=number_slider_17)
deconstruct_brep_3 = DeconstructBrep(Brep=extrude)  # -> Faces, Edges, Vertices
extrude_2 = Extrude(Base=deconstruct_brep_3.Edges, Direction=unit_y_2)

# ----
# 2-Attractor Point
dimensions = Dimensions(Surface=extrude)  # -> UDimension, VDimension
series_4 = Series(Start="0", Step="0.1", Count=expr("x*10+1", dimensions.VDimension))
series_5 = Series(Start="0", Step="0.1", Count=expr("x*10+1", dimensions.UDimension))
jitter_5 = Jitter(List=series_5, Jitter=1, Seed=expr("x*5", addition))  # -> Values, Indices
jitter_6 = Jitter(List=series_4, Jitter=1, Seed=addition)  # -> Values, Indices
list_item_5 = ListItem(List=jitter_5.Values, Index=0, Wrap=True)
list_item_6 = ListItem(List=jitter_6.Values, Index=0, Wrap=True)
construct_point = ConstructPoint(XCoordinate=list_item_5, YCoordinate=expr("-x", list_item_6), ZCoordinate=0)
panel_57 = Panel(construct_point)
evaluate_surface = EvaluateSurface(Surface=extrude, Point=construct_point)  # -> Point, Normal, UDirection, VDirection, Frame

surface = Surface(list_item_3.Item)
opaquemod3_2 = HBOpaqueModifier3(name=panel_50, r_ref=panel_51, g_ref=panel_51, b_ref=panel_51)  # -> modifier; plug-in component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
opaquemod3_3 = HBOpaqueModifier3(name=panel_49, r_ref=panel_55, g_ref=panel_55, b_ref=panel_55)  # -> modifier; plug-in component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
glassmod3 = HBGlassModifier3(name=panel_52, r_trans=panel_53, g_trans=panel_53, b_trans=panel_53)  # -> modifier; plug-in component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
opaquemod3_4 = HBOpaqueModifier3(name=panel_56, r_ref=panel_54, g_ref=panel_54, b_ref=panel_54)  # -> modifier; plug-in component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
aperture = HBAperture(geo=window, rad_mod=transmod3_2)  # -> out, apertures; plug-in component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
panel_58 = Panel(list_item_5)  # disabled
face = HBFace(geo=ceiling, rad_mod=opaquemod3_2)  # -> out, faces; plug-in component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
face_2 = HBFace(geo=surface, rad_mod=opaquemod3)  # -> out, faces; plug-in component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
face_3 = HBFace(geo=floor, rad_mod=opaquemod3_3)  # -> out, faces; plug-in component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
face_4 = HBFace(geo=walls, rad_mod=opaquemod3_4)  # -> out, faces; plug-in component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
panel_59 = Panel(list_item_6)  # disabled
addsubface = HBAddSubface(hb_obj=flatten(face_2.faces), sub_faces=flatten(aperture.apertures))  # -> hb_obj; plug-in component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
concatenate = Concatenate(FragmentA=panel, FragmentB=panel_59)  # disabled
concatenate_2 = Concatenate(FragmentA=panel_2, FragmentB=panel_58)  # disabled

# ---- group: Model (continued)
data_5 = Data(flatten([addsubface, face_4.faces, face_3.faces, face.faces]))
room = HBRoom(faces=flatten(data_5), conditioned=True)  # -> out, room; plug-in component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

# ----
text_tag_3d = TextTag3D(Location=point, Text=concatenate, Size=number_slider_8, Colour=panel_3, Justification=7)  # disabled
text_tag_3d_2 = TextTag3D(Location=point_2, Text=concatenate_2, Size=number_slider_8, Colour=panel_3, Justification=7)  # disabled

# ----
# Shade
deconstruct_brep_4 = DeconstructBrep(Brep=extrude_2)  # -> Faces, Edges, Vertices
discontinuity = Discontinuity(Curve=deconstruct_brep_4.Edges, Level=1)  # -> flatten(Points), Parameters
list_item_7 = ListItem(List=flatten(deconstruct_brep_4.Edges), Index="15", Wrap=True)
length = Length(Curve=list_item_7)
list_item_8 = ListItem(List=discontinuity.Points, Index="21", Wrap=True)
number_slider_18 = Slider(30, range=0..100)
number_slider_19 = Slider(9, range=0..10)
xz = XZPlane(Origin=Point(0, 0, 0))
multiplication = Multiplication(A=length, B=Slider(1, range=0..1))
move_2 = Move(Geometry=xz, Motion=list_item_8)  # -> Geometry, Transform
division = Division(A=multiplication, B=number_slider_18)
sqgrid = Square(Plane=move_2.Geometry, Size=division, ExtentX=number_slider_18, ExtentY=Slider(9, range=0..100))  # -> simplify(Cells), Points
flip = FlipMatrix(Data=sqgrid.Cells)
X = UnitX(Factor=1)
explode = Explode(Curve=flip, Recursive=True)  # -> Segments, Vertices
area_2 = Area(Geometry=flip)  # -> Area, Centroid
move_3 = Move(Geometry=area_2.Centroid, Motion=X)  # -> Geometry, Transform
midpt = CurveMiddle(Curve=explode.Segments)  # -> simplify(Midpoint)
ln = Line(StartPoint=area_2.Centroid, EndPoint=move_3.Geometry)
pln = Plane(area_2.Centroid)
ln_2 = Line(StartPoint=midpt, EndPoint=graft(area_2.Centroid))
cull_i = CullIndex(List=explode.Vertices, Indices="4", Wrap=True)
rotax = RotateAxis(Geometry=pln, Angle=degrees(Slider(90, range=0..100)), Axis=ln)  # -> Geometry, Transform
ln_3 = Line(StartPoint=cull_i, EndPoint=graft(area_2.Centroid))
pt = Point(evaluate_surface.Point)
multiplication_2 = Multiplication(A=division, B=Slider(0.5, range=0..1))
pt_2 = Point(flatten(area_2.Centroid))
rectangle_2 = Rectangle(Plane=rotax.Geometry, XSize=multiplication_2, YSize=multiplication_2, Radius=0)  # -> Rectangle, Length
symsim = SymbolSimple(
    Style=Slider(6, range=0..10),
    Size=Slider(10, range=0..10),
    Rotation=0,
    Colour=ColourSwatch(SwatchColor=RGB(114, 77, 255)))
cp = ClosestPoint(Point=pt_2, Cloud=pt)  # -> ClosestPoint, CPIndex, Distance
arrpolar = PolarArray(Geometry=rectangle_2.Rectangle, Plane=rotax.Geometry, Count="4", Angle=degrees("360"))  # -> Geometry, Transform
symbol = SymbolDisplay(Location=pt, Display=symsim)
bnd = Bounds(Numbers=cp.Distance)
dom = ConstructDomain(DomainStart="-45", DomainEnd="0")
shift = ShiftList(List=arrpolar.Geometry, Shift="2", Wrap=True)
remap = RemapNumbers(Value=cp.Distance, Source=bnd, Target=dom)  # -> Mapped, Clipped
mesh = MeshBrep(
    Brep=shift,
    Settings={GridMaxCount=0, GridMinCount=16, JaggedSeams=False, MaxEdgeLength=0, MinEdgeLength=0.0001, MinTolerance=0, Refine=True, RefineAngle=0, RelativeTolerance=0.65, SimplePlanes=True, Tolerance=0})
graph = GraphMapper(
    remap.Mapped,
    x0=-45,
    x1=0,
    y0=-45,
    y1=0,
    container_name="Bezier",
    cpx=[0, 0.1126938984, 0.2515922189, 1],
    cpy=[0, 0.4569168687, 1, 1])
tri = Triangulate(Mesh=mesh)  # -> Mesh, Count
faceb = FaceBoundaries(Mesh=tri.Mesh)
dup = DuplicateData(Data=graph, Number=Slider(1, range=0..10), Order=Toggle(False))  # -> graft(Data)
trim = TrimTree(Tree=faceb, Depth=Slider(1, range=0..10))
dispatch = Dispatch(List=trim, DispatchPattern=[True, False])  # -> ListA, ListB
expression = Expression(x=dup, Expression="If((x≥-30),x,-30)")
neg = Negative(Value=expression)
rotax_2 = RotateAxis(Geometry=dispatch.ListA, Angle=expr("x*3", degrees(neg)), Axis=ln_3)  # -> Geometry, Transform
rotax_3 = RotateAxis(Geometry=dispatch.ListB, Angle=expr("x*3", degrees(expression)), Axis=ln_3)  # -> Geometry, Transform
shift_2 = ShiftList(List=ln_3, Shift="1", Wrap=True)
partition = PartitionList(List=dup, Size="4")
rotax_4 = RotateAxis(Geometry=rotax_3.Geometry, Angle=degrees(partition), Axis=shift_2)  # -> Geometry, Transform
rotax_5 = RotateAxis(Geometry=rotax_2.Geometry, Angle=degrees(partition), Axis=shift_2)  # -> Geometry, Transform
merge_3 = Merge(Data1=rotax_5.Geometry, Data2=rotax_4.Geometry)
boundary = BoundarySurfaces(Edges=merge_3)
move_4 = Move(Geometry=boundary, Motion=list_item_8)  # -> Geometry, Transform

colour_swatch = ColourSwatch(SwatchColor=RGB(242, 215, 141))
split_argb = SplitARGB(Colour=colour_swatch)  # -> Alpha, Red, Green, Blue
preview = CustomPreview(Geometry=move_4.Geometry, Material=colour_swatch)
multiplication_3 = Multiplication(A=split_argb.Red, B="0.265")
multiplication_4 = Multiplication(A=split_argb.Green, B="0.670")
multiplication_5 = Multiplication(A=split_argb.Blue, B="0.065")
subtraction = Subtraction(A="0.11", B="0.5")
panel_60 = Panel("0")
transmod3_3 = HBTranslucentModifier3(
    name="shading_Aurora",
    r_diff_ref=multiplication_3,
    g_diff_ref=multiplication_4,
    b_diff_ref=multiplication_5,
    diff_trans="0.2",
    rough="0.2")  # -> modifier; plug-in component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
opaquemod3_5 = HBOpaqueModifier3(name="Structural Frames", r_ref="0.3", g_ref="0.3", b_ref="0.3", spec="0.1", rough="0")  # -> modifier; plug-in component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
shade = HBShade(geo=extrude_2, rad_mod=opaquemod3_5)  # -> out, shades; plug-in component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
shade_2 = HBShade(geo=move_4.Geometry, rad_mod=transmod3_3)  # -> out, shades; plug-in component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
addshade = HBAddShade(hb_obj=room.room, out_shades=flatten([shade_2.shades, shade.shades]))  # -> hb_obj; plug-in component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
model = HBModel(rooms=flatten(addshade))  # -> out, model; plug-in component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

vizbytype = HBVisualizeByType(hb_objs=model.model)  # -> walls, interior_walls, roofs, ceilings, exterior_floors, interior_floors, air_walls, apertures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; plug-in component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

# ----
# 4-Et
panel_61 = Panel("0.4")
gridrooms = HBSensorGridFromRooms(rooms=model.model, grid_size=panel_61, dist_floor="0.8")  # -> grid, points, mesh; plug-in component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
assigngridsviews = HBAssignGridsAndViews(model=model.model, grids=flatten(gridrooms.grid))  # -> model; plug-in component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
recipesettings = HBRecipeSettings(reload_old=False)  # -> settings; plug-in component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
pitgrid = HBPointInTimeGridBased(model=assigngridsviews, sky=climatebased, run_settings=recipesettings, run=Toggle(False))  # -> out, results; plug-in component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

# ----
# 5-Ev
panel_62 = Panel("1.15")
gridrooms_2 = HBSensorGridFromRooms(rooms=model.model, grid_size=panel_61, dist_floor=panel_62)  # -> grid, points, mesh; plug-in component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
sensorgrid = HBRadialSensorGrid(positions=gridrooms_2.points, dir_count="1", start_vec="0,-1,0")  # -> grid, points, vecs, mesh; plug-in component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
assigngridsviews_2 = HBAssignGridsAndViews(model=model.model, grids=flatten(sensorgrid.grid))  # -> model; plug-in component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
vector_display = VectorDisplay(Anchor=sensorgrid.points, Vector=sensorgrid.vecs)
pitgrid_2 = HBPointInTimeGridBased(model=assigngridsviews_2, sky=climatebased, run=Toggle(False))  # -> out, results; plug-in component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

# ----
# 1-Distances
unit_z_2 = UnitZ(Factor="0.8")
brep = Brep(floor)
move_5 = Move(Geometry=brep, Motion=unit_z_2)  # -> Geometry, Transform
deconstruct_brep_5 = DeconstructBrep(Brep=move_5.Geometry)  # -> Faces, graft(Edges), Vertices
pull_point = PullPoint(Point=gridrooms.points, Geometry=deconstruct_brep_5.Edges, ClosestOnly=True)  # -> ClosestPoint, Distance, Index
flip_matrix = FlipMatrix(Data=pull_point.Distance)
line = Line(StartPoint=evaluate_surface.Point, EndPoint=gridrooms.points)
length_2 = Length(Curve=line)
list_item_9 = ListItem(List=flip_matrix, Index=0, Wrap=True)  # -> flatten(Item), flatten(Item1), flatten(Item2), flatten(Item3)

list_item_10 = ListItem(List=gridrooms.points, Index=0, Wrap=True)
deconstruct = Deconstruct(Point=evaluate_surface.Point)  # -> XComponent, YComponent, ZComponent
deconstruct_2 = Deconstruct(Point=list_item_10)  # -> XComponent, YComponent, ZComponent
subtraction_2 = Subtraction(A=deconstruct.ZComponent, B=deconstruct_2.ZComponent)
unit_z_3 = UnitZ(Factor=expr("-x", subtraction_2))
heatmap = LBSpatialHeatmap(values=pitgrid_2.results, mesh=gridrooms_2.mesh, legend_title="lux", global_title="Vertical Eye Illuminance (Ev)")  # -> mesh, legend, title, colors, legend_par, vis_set; plug-in component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
heatmap_2 = LBSpatialHeatmap(values=pitgrid.results, mesh=gridrooms.mesh, legend_title="lux", global_title="Task Illuminance (Et)")  # -> mesh, legend, title, colors, legend_par, vis_set; disabled; plug-in component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
move_6 = Move(Geometry=evaluate_surface.Point, Motion=unit_z_3)  # -> Geometry, Transform
line_2 = Line(StartPoint=move_6.Geometry, EndPoint=gridrooms.points)
move_7 = Move(Geometry=[heatmap_2.mesh, heatmap_2.legend, heatmap_2.title], Motion=unit_x)  # -> Geometry, Transform; disabled
angle = Angle(VectorA=line_2, VectorB=line)  # -> Angle, Reflex
degrees = Degrees(Radians=angle.Angle)
list_length = ListLength(List=gridrooms.points)
duplicate_data_5 = DuplicateData(Data=c_script.A, Number=list_length, Order=True)
duplicate_data_6 = DuplicateData(Data=panel_41, Number=list_length, Order=True)

# ----
# 3-Sky
importepw = LBImportEPW(epw_file=downloadepw_2.epw_file)  # -> location, dry_bulb_temperature, dew_point_temperature, relative_humidity, wind_speed, wind_direction, direct_normal_rad, diffuse_horizontal_rad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; plug-in component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
analysisperiod_2 = LBAnalysisPeriod(start_month=month, start_day=day, start_hour=hour, end_month=month, end_day=day, end_hour=hour)  # -> period, hoys, dates; plug-in component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
importloc_2 = LBImportLocation(epw_file=downloadepw_2.epw_file)  # -> location; plug-in component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
applyper_4 = LBApplyAnalysisPeriod(data=importepw.total_sky_cover, period=analysisperiod_2.period)  # -> data; plug-in component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
xdata_4 = LBDeconstructData(data=applyper_4)  # -> header, values; plug-in component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
panel_63 = Panel(xdata_4.values)

sunpath_2 = LBSunPath(location=constrloc, hoys=analysisperiod_2.hoys, scale=1)  # -> report, vectors, altitudes, azimuths, hoys, sun_pts, analemma, daily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; disabled; plug-in component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
panel_64 = Panel(sunpath_2.altitudes)  # disabled
panel_65 = Panel(sunpath_2.azimuths)  # disabled
applyper_5 = LBApplyAnalysisPeriod(data=decnstrwea_2.dir, period=analysisperiod_2.period)  # -> data; disabled; plug-in component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
xdata_5 = LBDeconstructData(data=applyper_5)  # -> header, values; disabled; plug-in component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
panel_66 = Panel(xdata_5.values)  # disabled
applyper_6 = LBApplyAnalysisPeriod(data=importepw.wind_speed, period=analysisperiod_2.period)  # -> data; plug-in component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
applyper_7 = LBApplyAnalysisPeriod(data=importepw.dry_bulb_temperature, period=analysisperiod_2.period)  # -> data; plug-in component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
applyper_8 = LBApplyAnalysisPeriod(data=importepw.relative_humidity, period=analysisperiod_2.period)  # -> data; plug-in component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
sunpath_3 = LBSunPath(location=importloc_2, hoys=analysisperiod_2.hoys, scale=1)  # -> report, vectors, altitudes, azimuths, hoys, sun_pts, analemma, daily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; plug-in component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
xdata_6 = LBDeconstructData(data=applyper_6)  # -> header, values; plug-in component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
decnstrloc = LBDeconstructLocation(location=importloc_2)  # -> name, latitude, longitude, time_zone, elevation; plug-in component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
xdata_7 = LBDeconstructData(data=applyper_7)  # -> header, values; plug-in component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
xdata_8 = LBDeconstructData(data=applyper_8)  # -> header, values; plug-in component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

panel_67 = Panel(sunpath_3.altitudes)
panel_68 = Panel(sunpath_3.azimuths)

panel_69 = Panel(decnstrloc.elevation)
panel_70 = Panel(decnstrloc.longitude)
panel_71 = Panel(decnstrloc.latitude)
panel_72 = Panel(xdata_7.values)
panel_73 = Panel(xdata_8.values)
panel_74 = Panel(xdata_6.values)
applyper_9 = LBApplyAnalysisPeriod(data=decnstrwea_3.diff, period=analysisperiod_2.period)  # -> data; plug-in component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
applyper_10 = LBApplyAnalysisPeriod(data=decnstrwea_3.dir, period=analysisperiod_2.period)  # -> data; plug-in component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
applyper_11 = LBApplyAnalysisPeriod(data=decnstrwea_3.glob, period=analysisperiod_2.period)  # -> data; plug-in component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
xdata_9 = LBDeconstructData(data=applyper_9)  # -> header, values; plug-in component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
xdata_10 = LBDeconstructData(data=applyper_11)  # -> header, values; plug-in component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
xdata_11 = LBDeconstructData(data=applyper_10)  # -> header, values; plug-in component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
panel_75 = Panel(xdata_9.values)
panel_76 = Panel(xdata_10.values)
panel_77 = Panel(xdata_11.values)
duplicate_data_7 = DuplicateData(Data=panel_77, Number=list_length, Order=True)
duplicate_data_8 = DuplicateData(Data=panel_75, Number=list_length, Order=True)
duplicate_data_9 = DuplicateData(Data=panel_74, Number=list_length, Order=True)
duplicate_data_10 = DuplicateData(Data=panel_72, Number=list_length, Order=True)
duplicate_data_11 = DuplicateData(Data=panel_71, Number=list_length, Order=True)
duplicate_data_12 = DuplicateData(Data=panel_70, Number=list_length, Order=True)
duplicate_data_13 = DuplicateData(Data=panel_69, Number=list_length, Order=True)
duplicate_data_14 = DuplicateData(Data=panel_73, Number=list_length, Order=True)

random_reduce = RandomReduce(List=list_item_9.Item2, Reduction="0", Seed=1)
random_reduce_2 = RandomReduce(List=list_item_9.Item1, Reduction="0", Seed=1)
random_reduce_3 = RandomReduce(List=list_item_9.Item, Reduction="0", Seed=1)
random_reduce_4 = RandomReduce(List=length_2, Reduction="0", Seed=1)
random_reduce_5 = RandomReduce(List=list_item_9.Item3, Reduction="0", Seed=1)
duplicate_data_15 = DuplicateData(Data=list_item_6, Number=list_length, Order=True)
duplicate_data_16 = DuplicateData(Data=list_item_5, Number=list_length, Order=True)
duplicate_data_17 = DuplicateData(Data=panel_76, Number=list_length, Order=True)
duplicate_data_18 = DuplicateData(Data=panel_63, Number=list_length, Order=True)
duplicate_data_19 = DuplicateData(Data=panel_67, Number=list_length, Order=True)
duplicate_data_20 = DuplicateData(Data=panel_68, Number=list_length, Order=True)
random_reduce_6 = RandomReduce(List=pitgrid.results, Reduction="0", Seed=1)
random_reduce_7 = RandomReduce(List=pitgrid_2.results, Reduction="0", Seed=1)
entwine_2 = Entwine(
    Branch00=duplicate_data_5,
    Branch01=random_reduce_3,
    Branch02=random_reduce_2,
    Branch03=random_reduce,
    Branch04=random_reduce_5,
    Branch05=random_reduce_4,
    Branch06=degrees,
    Branch07=duplicate_data_15,
    Branch08=duplicate_data_16,
    Branch09=duplicate_data_7,
    Branch010=duplicate_data_8,
    Branch011=duplicate_data_17,
    Branch012=duplicate_data_18,
    Branch013=duplicate_data_19,
    Branch014=duplicate_data_20,
    Branch015=duplicate_data_6,
    Branch016=duplicate_data_10,
    Branch017=duplicate_data_14,
    Branch018=duplicate_data_9,
    Branch019=duplicate_data_11,
    Branch020=duplicate_data_12,
    Branch021=duplicate_data_13,
    Branch022=random_reduce_6,
    Branch023=random_reduce_7,
    FlattenInputs=True)
param_viewer = ParamViewer(entwine_2)
null_item = NullItem(Item=entwine_2)  # -> NullFlags, InvalidFlags, Description
panel_78 = Panel("""seed 
SP-Soth-Dis
 SP-East-Dis
 SP-North-Dis
 SP-West-Dis
SP-Ap-Dis
Angle
AP-Length
AP-Width
Dir-wea
Diff-wea
glob-wea
Total-Sky-cover
Altitude
Azimuth
city
dry_bulb_temperature
relative_humidity
wind_speed
latitude
longitude
elevation
Et
Ev""")
pick_n_choose = PickNChoose(Pattern=null_item.NullFlags, Stream0=entwine_2, Stream1="Error")
create_csv_2 = CreateCSV(DataGridHeaders=panel_78, ValueTree=pick_n_choose, Delimiter=",")

data_recorder_2 = DataRecorder(create_csv_2, DataLimit=-10, RecordData=True)
# Test
panel_79 = Panel(data_recorder_2)

# ----
# Train
panel_80 = Panel(data_recorder_2)
